# Grasshopper definition mirror.gh (Grasshopper 1.0.8)

number_slider = Slider(1, range=0..1)
brep = Brep([<brep referenced from the Rhino model> x6])
debrep = DeconstructBrep(Brep=brep)  # -> Faces, Edges, Vertices
line = Line(Line((17, 27, 544.3142), (17, 27, 1391.992051)))
item = ListItem(List=debrep.Faces, Index=number_slider, Wrap=True)
debrep_2 = DeconstructBrep(Brep=item)  # -> Faces, Edges, Vertices
item_2 = ListItem(List=debrep_2.Vertices, Index=flatten(Slider(2, range=0..10)), Wrap=True)
item_3 = ListItem(List=debrep_2.Vertices, Index=flatten(number_slider), Wrap=True)
item_4 = ListItem(List=debrep_2.Vertices, Index=flatten(Slider(3, range=0..10)), Wrap=True)
pl_3pt = Plane3Pt(PointA=item_3, PointB=item_2, PointC=item_4)
mirror = Mirror(Geometry=line, Plane=pl_3pt)  # -> Geometry, Transform
shift = ShiftList(List=pl_3pt, Shift=Slider(0, range=0..10), Wrap=True)
mirror_2 = Mirror(Geometry=flatten(mirror.Geometry), Plane=shift)  # -> Geometry, Transform
