# Grasshopper definition asd.gh (Grasshopper 1.0.8)

pt = Point(<point referenced from the Rhino model>)
pt_2 = Point(<point referenced from the Rhino model>)
X = UnitX(Factor=1)
ln = Line(StartPoint=pt, EndPoint=pt_2)
circle = CircleCNR(Center=pt, Normal=X, Radius=Slider(260, range=0..1000))
curvepoint = PointOnCurve(circle, parameter=0.132)
number_slider = Slider(400, range=0..1000)
ln_2 = Line(StartPoint=pt, EndPoint=curvepoint)
pt_3 = ConstructPoint(XCoordinate=0, YCoordinate=0, ZCoordinate=0)
ln_3 = Line(StartPoint=ln_2)
