# Grasshopper definition mirror_rotate_copy.gh (Grasshopper 1.0.8)

rotate = Slider(0, range=0..1)
pt = ConstructPoint(XCoordinate=0, YCoordinate=0, ZCoordinate=Slider(100, range=0..100))
pt_2 = Point(<point referenced from the Rhino model>)
brep = Brep(<brep referenced from the Rhino model>)
pt_3 = Point(<point referenced from the Rhino model>)
pt_4 = Point(<point referenced from the Rhino model>)
pl = ConstructPlane(Origin=pt, XAxis=Vector(1, 0, 0), YAxis=Vector(0, 1, 0))
cir = Circle(Plane=pl, Radius=Slider(200, range=0..1000))
pt_5 = Point(<point referenced from the Rhino model>)
divide = DivideCurve(Curve=cir, Count=Slider(6, range=0..100), Kinks=False)  # -> Points, Tangents, Parameters
shift = ShiftList(List=divide.Points, Shift=1, Wrap=True)
ln = Line(StartPoint=divide.Points, EndPoint=shift)
ln_2 = Line(StartPoint=divide.Points, EndPoint=pt_5)
pt_6 = ConstructPoint(XCoordinate=0, YCoordinate=0, ZCoordinate=Slider(224, range=0..1000))
ln_3 = Line(StartPoint=pt_5, EndPoint=pt_6)
crv_cp = CurveClosestPoint(Point=pt_6, Curve=ln_2)  # -> Point, Parameter, Distance
Z = UnitZ(Factor=1)
pt_7 = Point(<point referenced from the Rhino model>)
vec2pt = Vector2Pt(PointA=pt_5, PointB=divide.Points, Unitize=False)  # -> Vector, Length
pi = Pi(Factor=1)
vec2pt_2 = Vector2Pt(PointA=pt_3, PointB=pt_4, Unitize=False)  # -> Vector, Length
vec2pt_3 = Vector2Pt(PointA=crv_cp.Point, PointB=pt_6, Unitize=False)  # -> Vector, Length
shift_2 = ShiftList(List=divide.Points, Shift=Slider(6, range=0..10), Wrap=True)
crv_cp_2 = CurveClosestPoint(Point=shift, Curve=ln_2)  # -> Point, Parameter, Distance
integer_division = IntegerDivision(A=pi, B=Slider(2, range=0..2))
shift_3 = ShiftList(List=divide.Points, Shift=Slider(8, range=0..10), Wrap=True)
rot3d = Rotate3D(Geometry=brep, Angle=Slider(0, range=0..1), Center=pt_3, Axis=vec2pt_2.Vector)  # -> Geometry, Transform
vec2pt_4 = Vector2Pt(PointA=shift_2, PointB=crv_cp_2.Point, Unitize=False)  # -> Vector, Length
pl_2 = ConstructPlane(Origin=crv_cp.Point, XAxis=vec2pt_3.Vector, YAxis=vec2pt.Vector)
vec2pt_5 = Vector2Pt(PointA=crv_cp_2.Point, PointB=shift_3, Unitize=False)  # -> Vector, Length
item = ListItem(List=vec2pt_5.Vector, Index=0, Wrap=True)
xy = XYPlane(Origin=Point(0, 0, 0))
rot3d_2 = Rotate3D(Angle=1.570796327, Center=Point(0, 0, 0), Axis=Vector(0, 0, 1))  # -> Geometry, Transform
rot3d_3 = Rotate3D(Geometry=pl_2, Angle=integer_division, Center=pl_2, Axis=Vector(0, 0, 1))  # -> Geometry, Transform
item_2 = ListItem(List=vec2pt_4.Vector, Index=0, Wrap=True)
arrpolar = PolarArray(Geometry=pt_6, Plane=rot3d_3.Geometry, Count=Slider(3, range=0..10), Angle=6.283185307)  # -> Geometry, Transform
angle = Angle(VectorA=item_2, VectorB=item)  # -> Angle, Reflex; disabled
pi_2 = Pi(Factor=Slider(2, range=0..10))
number_slider = Slider(2, range=0..10)  # disabled
pl_origin = PlaneOrigin(Base=xy, Origin=pt_2)
pi_3 = Pi(Factor=1)  # disabled
pi_4 = Pi(Factor=rotate)
ln_4 = Line(StartPoint=arrpolar.Geometry, EndPoint=pt_5)
arrpolar_2 = PolarArray(Geometry=rot3d.Geometry, Plane=pl_origin, Count=Slider(6, range=0..10), Angle=pi_2)  # -> Geometry, Transform
subtraction = Subtraction(A=pi_3, B=angle.Angle)
pi_5 = Pi(Factor=number_slider)
rotate_2 = Rotate(Geometry=arrpolar_2.Geometry, Angle=pi_4, Plane=PlaneXY(0, 0, 0))  # -> Geometry, Transform
division = Division(A=pi_5, B=subtraction)
brep_2 = Brep([<brep referenced from the Rhino model> x2])
panel = Panel(division)
line = LineSDL(Start=pt_7, Direction=Z, Length=Slider(243, range=0..1000))
cluster = Cluster(B=rotate_2.Geometry)
brep_3 = Brep(<brep referenced from the Rhino model>)
mirror = Mirror(Geometry=brep_3, Plane=cluster)  # -> Geometry, Transform

# ==== cluster Cluster
number_slider = Slider(1, range=0..1)
B = ClusterInput()
debrep = DeconstructBrep(Brep=B)  # -> Faces, Edges, Vertices
item = ListItem(List=debrep.Faces, Index=number_slider, Wrap=True)
debrep_2 = DeconstructBrep(Brep=item)  # -> Faces, Edges, Vertices
item_2 = ListItem(List=debrep_2.Vertices, Index=flatten(Slider(2, range=0..10)), Wrap=True)
item_3 = ListItem(List=debrep_2.Vertices, Index=flatten(number_slider), Wrap=True)
item_4 = ListItem(List=debrep_2.Vertices, Index=flatten(Slider(3, range=0..10)), Wrap=True)
pl_3pt = Plane3Pt(PointA=item_3, PointB=item_2, PointC=item_4)
pl = ClusterOutput(pl_3pt)
